# Dynamo graph assembly_shipping_dimensions.dyn "Dimensiones reales de envío de montaje" (Dynamo 3.6.0.9395)

file_path = Filename("..\..\SF-316 Hierro - Berberian\08-Computos\01-COMPUTOS REVIT\Dimensiones reales Montajes.xlsx")
string = StringInput("Pesos Montajes")
python_script = Python()  # CPython3; unwired: IN[0]
# ---------- python_script.python (95 lines) ----------
import clr
import math
from System.Collections.Generic import List

# Cargar API
clr.AddReference('RevitAPI')
from Autodesk.Revit.DB import *

clr.AddReference('RevitServices')
from RevitServices.Persistence import DocumentManager

doc = DocumentManager.Instance.CurrentDBDocument

# --- FUNCIÓN CLAVE: OBTENER PUNTOS DE LA GEOMETRÍA ---
def get_solid_vertices(element):
    vertices = []
    opt = Options()
    opt.DetailLevel = ViewDetailLevel.Fine
    geo_elem = element.get_Geometry(opt)
    
    if geo_elem:
        for geo_obj in geo_elem:
            # Manejar Sólidos Directos
            if isinstance(geo_obj, Solid) and geo_obj.Volume > 0:
                for edge in geo_obj.Edges:
                    vertices.extend([p for p in edge.Tessellate()])
            # Manejar Geometría Anidada (Instancias)
            elif isinstance(geo_obj, GeometryInstance):
                inst_geo = geo_obj.GetInstanceGeometry()
                for inst_obj in inst_geo:
                    if isinstance(inst_obj, Solid) and inst_obj.Volume > 0:
                        for edge in inst_obj.Edges:
                            vertices.extend([p for p in edge.Tessellate()])
    return vertices

# --- CONFIGURACIÓN ---
F_METROS = 0.3048 # Pies a Metros
assemblies = FilteredElementCollector(doc).OfCategory(BuiltInCategory.OST_Assemblies).WhereElementIsNotElementType().ToElements()

data_export = []
# L = Largo (X local), W = Ancho (Y local), H = Alto (Z local)
data_export.append(["Montaje", "Largo Total (m)", "Ancho Total (m)", "Alto Total (m)", "Volumen Envío (m3)"])

for assem in assemblies:
    try:
        # 1. Obtener la Transformación del Montaje (Su orientación en el espacio)
        # Esto es vital para medirlo recto y no en diagonal
        trans = assem.GetTransform()
        inverse_trans = trans.Inverse
        
        member_ids = assem.GetMemberIds()
        all_points_local = []
        
        # 2. Recolectar todos los puntos de todas las piezas
        for m_id in member_ids:
            elem = doc.GetElement(m_id)
            if not elem: continue
            
            world_points = get_solid_vertices(elem)
            
            # 3. TRUCO DE MAGIA: Convertir puntos de Mundo a Local
            # Llevamos los puntos al "universo" del montaje donde está recto
            for pt in world_points:
                local_pt = inverse_trans.OfPoint(pt)
                all_points_local.append(local_pt)
        
        if all_points_local:
            # 4. Calcular Minimos y Maximos en Local
            xs = [p.X for p in all_points_local]
            ys = [p.Y for p in all_points_local]
            zs = [p.Z for p in all_points_local]
            
            length = (max(xs) - min(xs)) * F_METROS
            width = (max(ys) - min(ys)) * F_METROS
            height = (max(zs) - min(zs)) * F_METROS
            ship_vol = length * width * height
            
            # Redondear para que sea limpio
            # Ordenamos las dimensiones para que Largo sea siempre la mayor (opcional)
            dims = sorted([length, width, height], reverse=True)
            
            data_export.append([
                assem.Name, 
                round(dims[0], 3), # Largo Mayor
                round(dims[1], 3), # Ancho/Alto
                round(dims[2], 3), # Espesor/Alto
                round(ship_vol, 3)
            ])
            
    except Exception as e:
        # Si falla, poner ceros
        data_export.append([assem.Name, 0, 0, 0, "Error: " + str(e)])

# SALIDA PARA EXCEL
OUT = data_export
# ----------------------------------------
openXMLExportExcel = Data.OpenXMLExportExcel(filePath=file_path, sheetName=string, data=python_script)
watch = Watch(python_script)
